# Grasshopper definition _test.gh (Grasshopper 1.0.7)
# plug-ins: ghJSON

file = ReadFile(File="C:\Users\starsky\stealingfired\bcn-energy\json\test.json", PerLineParse=False)
frmjson = FromJSON(JSON=file)
jpath = JSONPath(JObject=frmjson, JSONPathQuery="$.db[*].zones[*].geoDataBase")
frmjson_2 = FromJSON(JSON=jpath)
jpath_2 = JSONPath(JObject=frmjson_2, JSONPathQuery="$.heights.block_height")  # -> simplify(Data)
jpath_3 = JSONPath(JObject=frmjson_2, JSONPathQuery="$.xyCoordinates[*][1]")  # -> simplify(Data)
jpath_4 = JSONPath(JObject=frmjson_2, JSONPathQuery="$.xyCoordinates[*][0]")  # -> simplify(Data)
jpath_5 = JSONPath(JObject=frmjson_2, JSONPathQuery="$.heights.block_localization")  # -> simplify(Data)
pt = ConstructPoint(XCoordinate=jpath_4, YCoordinate=jpath_3, ZCoordinate=0)
pline = PolyLine(Vertices=pt, Closed=Toggle(False))
Z = UnitZ(Factor=jpath_5)
max = Maximum(A=jpath_2, B=Slider(0.1, range=0..0.1))
move = Move(Geometry=pline, Motion=Z)  # -> Geometry, Transform
Z_2 = UnitZ(Factor=max)
extr = Extrude(Base=move.Geometry, Direction=Z_2)
