# Grasshopper definition test.gh (Grasshopper 1.0.7)
# plug-ins: ghJSON

file = ReadFile(File="C:\Users\starsky\stealingfired\bcn-energy\json\test.json", PerLineParse=False)
frmjson = FromJSON(JSON=file)
jpath = JSONPath(JObject=frmjson, JSONPathQuery="$.db[*].zones[*].geoDataBase")
frmjson_2 = FromJSON(JSON=jpath)
jpath_2 = JSONPath(JObject=frmjson_2, JSONPathQuery="$.heights.block_height")  # -> simplify(Data)
jpath_3 = JSONPath(JObject=frmjson_2, JSONPathQuery="$.xyCoordinates[*][1]")  # -> simplify(Data)
jpath_4 = JSONPath(JObject=frmjson_2, JSONPathQuery="$.xyCoordinates[*][0]")  # -> simplify(Data)
pt = ConstructPoint(XCoordinate=jpath_4, YCoordinate=jpath_3, ZCoordinate=0)
tstat = TreeStatistics(Tree=pt)  # -> Paths, Length, Count
item = ListItem(List=tstat.Paths, Index=Slider(3, range=0..10), Wrap=True)
branch = TreeBranch(Tree=pt, Path=item, MaintainPaths=True)
shift = ShiftList(List=branch, Shift=Slider(0, range=0..10), Wrap=Toggle(False))
pline = PolyLine(Vertices=shift, Closed=False)
panel = Panel(shift)
